# Grasshopper definition ee_icetool.gh (Grasshopper 1.0.8)
# plug-ins: HDTTreeUtils
# Environmental analysis workflow (ICEtool) that loads a Rhino model from a 3dm file by layers (buildings, tree canopy, materials), meshes and simplifies it, then runs Ladybug sun-hours shadow and incident radiation studies on a grid. Weather comes from an EPW file downloaded or imported for a chosen city, with controls for month, day, grid size and run toggles. Results are coloured meshes with legends; a work-in-progress group handles non-horizontal surfaces.

button = Button()  # disabled
epwmap = LBEPWmap(epw_map=button)  # -> report; disabled; plug-in component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

# ---- group: controls
panel = Panel("https://energyplus-weather.s3.amazonaws.com/europe_wmo_region_6/FRA/FRA_Paris.Orly.071490_IWEC/FRA_Paris.Orly.071490_IWEC.zip")
weather = ValueList({"Paris (download)": 0, "Toulouse (QGIS example)": 1}, selected="Toulouse (QGIS example)")
month = Slider(7, range=1..12)
temp_h = Slider(16, range=0..23)
file = ValueList({"data\qgis-example.3dm", "data\simple-example.3dm"}, selected="data\simple-example.3dm")
day = Slider(1, range=1..31)
list = ValueList({"gh\icetool_solver.py", "gh\icetool_qgis_compat.py"}, selected="gh\icetool_qgis_compat.py")
panel_2 = Panel("data\ToulouseWeatherData.epw")
run_radiation = BooleanToggle(False)  # disabled
run_shadows = BooleanToggle(True)
run_icetool = BooleanToggle(True)
grid = ValueList({".5", "1", "2", "3", "5", "10"}, selected="2")

# ----
shadow_h = Slider(13, range=0..14)
equals = EqualityFilter(Value="Mesh")  # -> Equal, Unequal

downloadepw = LBDownloadWeather(weather_URL=panel)  # -> epw_file, stat_file, ddy_file; plug-in component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
analysisperiod = LBAnalysisPeriod(start_month=month, start_day=day, start_hour=0, end_month=month, end_day=day)  # -> period, simplify(hoys), dates; plug-in component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
filter = StreamFilter(Gate=weather, Stream0=downloadepw.epw_file, Stream1=panel_2)
importepw = LBImportEPW(epw_file=filter)  # -> location, dry_bulb_temperature, dew_point_temperature, relative_humidity, wind_speed, wind_direction, direct_normal_rad, diffuse_horizontal_rad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; plug-in component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

data = Data(temp_h)

# ---- group: load rhino models
panel_3 = Panel("""Model Layer : materials::
Model Layer : trees_canopy
Model Layer : buildings""")
_3dm = Import3DM(File=file, Layer="*", Name="*")
object = ModelObject(Object=_3dm)  # -> Object, Geometry, Layer
tmatch = MatchText(Text=object.Layer, RegEx=graft(panel_3), Case=True)
custom_mesh_settings = SettingsCustom(
    StitchSeams=True,
    SimplePlanes=False,
    Refine="0",
    MinCount=16,
    MaxCount=100,
    AspectRatio=20,
    MaxDistance=0,
    MaxAngle=20,
    MinEdge=expr("x/1.1", grid),
    MaxEdge=expr("x*1.1", grid))
cull = CullPattern(List=object.Geometry, CullPattern=tmatch)
cull_2 = CullPattern(List=object.Layer, CullPattern=tmatch)
layer = ModelLayer(Layer=cull_2)  # -> Layer, Name
bang = ExplodeTree(Data=layer.Name)  # -> flatten(Branch0), flatten(Branch1), flatten(Branch2)

# ----
filter_2 = FilterContent(Content=cull, Filter=equals.Equal)
filter_3 = FilterContent(Content=cull, Filter=equals.Unequal)

# ---- group: load rhino models (continued)
mesh = MeshBrep(Brep=filter_3, Settings=custom_mesh_settings)

# ----
mesh_2 = Mesh([filter_2, mesh])

# ---- group: load rhino models (continued)
bang_2 = ExplodeTree(Data=mesh_2)  # -> flatten(Branch0), flatten(Branch1), flatten(Branch2)

# ---- group: check normals
facen = FaceNormals(Mesh=[bang_2.Branch2, bang_2.Branch0])  # -> Centers, Normals; disabled
vdis = VectorDisplay(Anchor=facen.Centers, Vector=facen.Normals)  # disabled

# ---- group: simplify
graft = GraftTree(Tree=bang.Branch0, IncludeEmptyLists=True, IncludeNullItems=True)
graft_2 = GraftTree(Tree=bang_2.Branch0, IncludeEmptyLists=True, IncludeNullItems=True)
mjoin = MeshJoin(Meshes=graft_2)
facen_2 = FaceNormals(Mesh=mjoin)  # -> simplify(Centers), Normals
lng = ListLength(List=facen_2.Centers)
repeat = RepeatData(Data=simplify(graft), Length=simplify(lng))  # -> simplify(flatten(Data))

# ---- group: WIP-non-horizontal surfaces
data_2 = Data(analysisperiod.hoys)  # disabled
assign_paths = AssignPaths(InputData=flatten(data_2), PathsToAssign=flatten(data_2))  # disabled
item = ListItem(List=data_2, Index=0, Wrap=True)  # disabled
mjoin_2 = MeshJoin(Meshes=flatten(bang_2.Branch2))  # disabled
lng_2 = ListLength(List=data_2)  # disabled
diffuse_rad = Data(importepw.diffuse_horizontal_rad)  # disabled
direct_rad = Data(importepw.direct_normal_rad)  # disabled
hoys = Integer(assign_paths)  # disabled
location = Data(importepw.location)  # disabled
panel_4 = Panel("0")  # disabled
skymatrix = LBCumulativeSkyMatrix(location=location, direct_rad=direct_rad, diffuse_rad=diffuse_rad, hoys=hoys, high_density=panel_4)  # -> report, sky_mtx; disabled; plug-in component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
assign_paths_2 = AssignPaths(InputData=flatten(skymatrix.sky_mtx), PathsToAssign=flatten(hoys))  # disabled
panel_5 = Panel("10")  # disabled
panel_6 = Panel(".1")  # disabled
incidentradiation = LBIncidentRadiation(sky_mtx=assign_paths_2, geometry=flatten(mjoin_2), grid_size=panel_5, offset_dist=panel_6, run=run_radiation)  # -> report, points, results, total, mesh, legend, title, int_mtx; disabled; plug-in component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
kwh_m²_wh_m² = Number(expr("x*1000", incidentradiation.results))  # disabled
panel_7 = Panel(lng_2)  # disabled
panel_8 = Panel("1")  # disabled
colrange = LBColorRange(index=panel_8)  # -> colors; disabled; plug-in component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
H = Slider(12, range=0..71)  # disabled
panel_9 = Panel("0")  # disabled
panel_10 = Panel("1000")  # disabled
data_3 = Data(kwh_m²_wh_m²)  # disabled
legendpar = LBLegendParameters(min=panel_9, max=panel_10, colors=colrange)  # -> leg_par; disabled; plug-in component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
addition = Addition(A=item, B=H)  # disabled
branch = TreeBranch(Tree=simplify(data_3), Path=addition, MaintainPaths=True)  # disabled
panel_11 = Panel("RAD [Wh/m²]")  # disabled
heatmap = LBSpatialHeatmap(values=branch, mesh=mjoin_2, legend_par=legendpar, legend_title=panel_11)  # -> mesh, legend, title, colors, legend_par, vis_set; disabled; plug-in component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

# ----
mjoin_3 = MeshJoin(Meshes=flatten(bang_2.Branch0))
mjoin_4 = MeshJoin(Meshes=flatten(mesh_2))

# ---- group: shadows
_121212 = ColourSwatch(SwatchColor=RGB(18, 18, 18))
f0f0f0 = ColourSwatch(SwatchColor=RGB(240, 240, 240))
xy = XYPlane(Origin=Point(0, 0, 0))
sunpath = LBSunPath(location=importepw.location, hoys=analysisperiod.hoys, scale=1)  # -> report, vectors, altitudes, azimuths, hoys, sun_pts, analemma, daily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; plug-in component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
legendpar_2 = LBLegendParameters(seg_count="2", colors=[_121212, f0f0f0], continuous_leg="0", vert_or_horiz="0", base_plane=xy)  # -> leg_par; plug-in component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
vec = Vector(simplify(graft(sunpath.vectors)))
directsunhours = LBDirectSunHours(
    vectors=vec,
    timestep="1",
    geometry=flatten(mjoin_3),
    context=flatten(mjoin_4),
    grid_size="10",
    legend_par=legendpar_2,
    run=run_shadows)  # -> report, points, results, mesh, legend, title, int_mtx; plug-in component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
py3 = Python3Script(ids_all=analysisperiod.hoys, ids_sun=sunpath.hoys, sun_results=directsunhours.results)  # -> out, sun; inputs ids_all: list, ids_sun: list, sun_results: tree
# ---------- py3: Python ----------
"""One branch per point, keyed by point ID, covering every point in
ids_all: real per-hour values for points ids_sun already solved by
DirectSunHours, and an all-zero branch (no sun all day) for the points
DirectSunHours dropped because they never saw the sun. 
The shape enforces one branch per hour of the analysed day (24), not one branch per point.
"""

from Grasshopper import DataTree
from Grasshopper.Kernel.Data import GH_Path

hours = sun_results.Branch(0).Count if sun_results.BranchCount else 0
sun_ids = list(ids_sun)

result = DataTree[object]()
for i in range(sun_results.BranchCount):
    result.AddRange(sun_results.Branch(i), GH_Path(int(sun_ids[i])))

solved = set(sun_ids)
for pid in ids_all:
    if pid not in solved:
        result.AddRange([0] * hours, GH_Path(int(pid)))

sun = result
# ---------- end py3 ----------

# ----
branch_2 = TreeBranch(Tree=simplify(directsunhours.mesh), Path=shadow_h, MaintainPaths=True)
icetool_solver = Script(Script=list, Run=run_icetool, Mat_ids=repeat, Sun=py3.sun, Epw_file=filter, Month=month, Day=day)  # -> Out, Min_c, Mean_c, Max_c, Report, Temp_c

bbox = BoundingBox(Content=flatten(mjoin_3), Plane=PlaneXY(0, 0, 0), UnionBox=True)  # -> Box, Box_2
debox = DeconstructBox(Box=bbox.Box)  # -> Plane, X, Y, Z
panel_12 = Panel("""min
max
average""")
dedomain = DeconstructDomain(Domain=debox.X)  # -> Start, End
concat = Concatenate(FragmentA=data, FragmentB="h")
expression = Expression(x=dedomain.End, y=dedomain.Start, Expression="(x-y)*1.618")
txt = Text([panel_12, concat])
lng_3 = ListLength(List=txt)
series = Series(Start=expression, Step=expression, Count=lng_3)
vec_2 = VectorXYZ(XComponent=graft(series), YComponent=0, ZComponent=0)  # -> Vector, Length
move = Move(Geometry=mjoin_3, Motion=vec_2.Vector)  # -> Geometry, Transform
graft_3 = GraftTree(Tree=txt, IncludeEmptyLists=True, IncludeNullItems=True)

range = Range(Domain=Domain(0, 1), Steps=10)
gradient = Gradient(
    LowerLimit=0,
    UpperLimit=1,
    Parameter=range,
    stops=[0: RGB(48, 18, 59), 0.0294: RGB(56, 40, 112), 0.0588: RGB(63, 62, 156), 0.0882: RGB(68, 82, 193), 0.118: RGB(70, 102, 221), 0.147: RGB(71, 122, 241)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])
item_2 = ListItem(List=icetool_solver.Temp_c, Index=data, Wrap=False)  # -> flatten(Item)
legendpar_3 = LBLegendParameters(min="15", max="50", colors=gradient, continuous_leg="1", num_decimals="0", larger_smaller="0", vert_or_horiz="1")  # -> leg_par; plug-in component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
entwine = Entwine(
    Branch00=icetool_solver.Min_c,
    Branch01=icetool_solver.Max_c,
    Branch02=icetool_solver.Mean_c,
    Branch03=item_2,
    FlattenInputs=True)  # -> simplify(Result)

move_2 = Move(Geometry=bang_2.Branch2, Motion=vec_2.Vector)  # -> Geometry, Transform
heatmap_2 = LBSpatialHeatmap(values=entwine, mesh=move.Geometry, legend_par=legendpar_3, legend_title=graft_3)  # -> mesh, legend, title, colors, legend_par, vis_set; plug-in component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
