# Grasshopper definition ee_surface temperature_example.gh (Grasshopper 1.0.7)
# plug-ins: Heteroptera, Human, Weaverbird, Hops, froGH, LadybugGrasshopper

# ---- group: load material database from ICETool repo
panel = Panel("https://raw.githubusercontent.com/Art-Ev/ICEtool/main/Scripts/Example/Step_1/Material_database.csv")
c_script = CSharpScript(url=panel)  # -> A; inputs url: String
# ---------- c_script: C# ----------
    System.Net.WebClient client = new System.Net.WebClient();
    A = client.DownloadString(url);
# ---------- end c_script ----------
c_script_2 = CSharpScript(str=c_script)  # -> out, A; inputs str: String
# ---------- c_script_2: C# ----------
A = str.Split(new string[] { Environment.NewLine }, StringSplitOptions.RemoveEmptyEntries);
# ---------- end c_script_2 ----------
tmatch = MatchText(Text=c_script_2.A, RegEx="FX", Case=True)
cull = CullPattern(List=c_script_2.A, CullPattern=invert(tmatch))
split = TextSplit(Text=cull, Separators=";")  # -> simplify(Result)
path = ConstructPath(Indices="0")
split_2 = SplitTree(Data=split, Masks=flatten(path))  # -> Positive, Negative
item = ListItem(List=split_2.Negative, Index=0, Wrap=True)  # -> flatten(Item)
panel_2 = Panel("""alb
em
Cv
lambd
ep
kc
ID""")
mindex = MemberIndex(Set=split_2.Positive, Member=panel_2)  # -> Index, Count
item_2 = ListItem(List=split, Index=flatten(mindex.Index), Wrap=True)
join = TextJoin(Text=item_2, Join=",")  # -> flatten(Result)

# ----
f_urlr = ReadFileFromURL(URLAddress=panel, ByLine=False)
panel_3 = Panel(item)

dpipeline = DynamicGeometryPipeline(
    LayerFilter="trees",
    TypeFilter="Point",
    NameFilter="*",
    GroupByLayer=False,
    GroupByType=False,
    IncludeHidden=True,
    IncludeLocked=True,
    enableFullPath=False,
    listenToAttributes=True)
Z = UnitZ(Factor="6")
division = Division(A="6", B=1.5)
move = Move(Geometry=dpipeline, Motion=Z)  # -> Geometry, Transform
msphere = MeshSphere(Base=move.Geometry, Radius=division, UCount="6", VCount="6")

dpipeline_2 = DynamicGeometryPipeline(
    LayerFilter=panel_3,
    TypeFilter="Brep",
    NameFilter="*",
    GroupByLayer=False,
    GroupByType=False,
    IncludeHidden=True,
    IncludeLocked=True,
    enableFullPath=False,
    listenToAttributes=True)
lng = ListLength(List=dpipeline_2)
repeat = RepeatData(Data=graft(panel_3), Length=lng)  # -> flatten(Data)
brep = Brep(flatten(dpipeline_2))

list = ValueList({".5", "1", "2", "3", "5", "10"}, selected="3")
custom_mesh_settings = SettingsCustom(
    StitchSeams=True,
    SimplePlanes=False,
    Refine="0",
    MinCount=16,
    MaxCount=100,
    AspectRatio=20,
    MaxDistance=0,
    MaxAngle=20,
    MinEdge=expr("x/1.1", list),
    MaxEdge=expr("x*1.1", list))
clean = CleanTree(RemoveNulls=True, RemoveInvalid=True, RemoveEmpty=True, Tree=brep)  # -> flatten(Tree)
mesh = MeshBrep(Brep=clean, Settings=custom_mesh_settings)
mjoin = MeshJoin(Meshes=flatten(msphere))
panel_4 = Panel("https://energyplus-weather.s3.amazonaws.com/europe_wmo_region_6/FRA/FRA_Paris.Orly.071490_IWEC/FRA_Paris.Orly.071490_IWEC.zip")
falsestart = LBFalseStartToggle(True)
panel_5 = Panel("ee_Surface-Temperature.gh")
geometry = Mesh(mesh)
materials = Text(repeat)
matdb = Text(join)
context = Mesh(mjoin)
hops = Hops(
    _Enabled=falsestart,
    MatDb=matdb,
    Geometry=geometry,
    Materials=materials,
    Context=context,
    Month=Slider(7, range=1..12),
    Day="21",
    EpwURL=panel_4,
    CacheResultsInMemory=False,
    CacheSolveResults=False,
    RemoteDefinitionLocation="C:\Users\SP\Documents\GitHub\echoesparis\ICEtool-gh\examples\ee_surface-temperature.gh",
    RemoteSolveVersion=(0, 1, 0),
    ShowInput_Enabled=True,
    ShowInput_Path=False,
    SynchronousSolve=True)  # -> Mesh, TC
h = Slider(7, range=0..23)
num = Number(hops.TC)

bnd = Bounds(Numbers=flatten(num))
dedomain = DeconstructDomain(Domain=bnd)  # -> Start, End
colrange = LBColorRange(index=Slider(0, range=0..25))  # -> colors; plug-in component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
int = Integer(dedomain.Start)
int_2 = Integer(dedomain.End)
expression = Expression(x=int, y=int_2, Expression="y-x+1")
panel_6 = Panel(bnd)
legendpar = LBLegendParameters(
    min=int,
    max=int_2,
    seg_count=expression,
    colors=colrange,
    continuous_leg="0",
    num_decimals="0",
    larger_smaller="0",
    vert_or_horiz="1")  # -> leg_par; plug-in component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

extremums = MinMax(Number=num)  # -> flatten(Minimum), flatten(Maximum)
avr = Average(Input=num)  # -> flatten(ArithmeticMean)
item_3 = ListItem(List=num, Index=h, Wrap=False)  # -> flatten(Item)
entwine = Entwine(Branch00=extremums.Minimum, Branch01=extremums.Maximum, Branch02=avr, Branch03=item_3, FlattenInputs=True)  # -> simplify(Result)

number_slider = Slider(100, range=0..200)

panel_7 = Panel("""min
max
average""")
concat = Concatenate(FragmentA=h, FragmentB="h")
txt = Text([panel_7, concat])
lng_2 = ListLength(List=txt)
series = Series(Start=number_slider, Step=number_slider, Count=lng_2)
vec = VectorXYZ(XComponent=graft(series), YComponent=0, ZComponent=0)  # -> Vector, Length
move_2 = Move(Geometry=hops.Mesh, Motion=vec.Vector)  # -> Geometry, Transform
graft = GraftTree(Tree=txt, IncludeEmptyLists=True, IncludeNullItems=True)

wires = BrepWireframe(Brep=brep, Density=-1)
wbedges = WeaverbirdsMeshEdges(MeshOrPolylines=msphere)
crv = Curve(flatten([wires, wbedges]))
move_3 = Move(Geometry=crv, Motion=vec.Vector)  # -> Geometry, Transform
black = ColourSwatch(SwatchColor=RGB(56, 56, 56))
heatmap = LBSpatialHeatmap(values=entwine, mesh=move_2.Geometry, legend_par=legendpar, global_title=graft)  # -> mesh, legend, title, colors, legend_par, vis_set; plug-in component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
previewlw = CustomPreviewLineweights(Geometry=move_3.Geometry, Shader=black, Absolute=False)
