# Grasshopper definition ee_surface temperature_example_material database.gh (Grasshopper 1.0.7)
# plug-ins: HDTTreeUtils, LadybugGrasshopper, Hops

_121212 = ColourSwatch(SwatchColor=RGB(18, 18, 18))
_80b1d3 = ColourSwatch(SwatchColor=RGB(128, 177, 211))
_8dd3c7 = ColourSwatch(SwatchColor=RGB(141, 211, 199))
fb8072 = ColourSwatch(SwatchColor=RGB(251, 128, 114))
bebada = ColourSwatch(SwatchColor=RGB(190, 186, 218))
fdb462 = ColourSwatch(SwatchColor=RGB(253, 180, 98))
panel = Panel("http://127.0.0.1:5000/surface_temp")
falsestart = LBFalseStartToggle(True)
col = Colour(_121212)
colrange = LBColorRange(index="0")  # -> colors; plug-in component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
xy = XYPlane(Origin=Point(0, 0, 0))
range = Range(Domain="0 to 5", Steps=expr("x-1", "24"))
pt = ConstructPoint(XCoordinate="-.2", YCoordinate=range, ZCoordinate=0)
series = Series(Start=0, Step=1, Count="24")
concat = Concatenate(FragmentA=series, FragmentB="h")
col_2 = Colour(RGB(18, 18, 18))

panel_2 = Panel("https://raw.githubusercontent.com/Art-Ev/ICEtool/main/Scripts/Example/Step_1/Material_database.csv")
c_script = CSharpScript(url=panel_2)  # -> A; inputs url: String
# ---------- c_script: C# ----------
    System.Net.WebClient client = new System.Net.WebClient();
    A = client.DownloadString(url);
# ---------- end c_script ----------
c_script_2 = CSharpScript(str=c_script)  # -> out, A; inputs str: String
# ---------- c_script_2: C# ----------
A = str.Split(new string[] { Environment.NewLine }, StringSplitOptions.RemoveEmptyEntries);
# ---------- end c_script_2 ----------
tmatch = MatchText(Text=c_script_2.A, RegEx="FX", Case=True)
cull = CullPattern(List=c_script_2.A, CullPattern=invert(tmatch))
split = TextSplit(Text=cull, Separators=";")  # -> simplify(Result)
path = ConstructPath(Indices="0")
split_2 = SplitTree(Data=split, Masks=flatten(path))  # -> Positive, Negative
panel_3 = Panel("""alb
em
Cv
lambd
ep
kc""")
mindex = MemberIndex(Set=split_2.Positive, Member=panel_3)  # -> flatten(Index), Count

mindex_2 = MemberIndex(Set=split_2.Positive, Member="ID")  # -> flatten(Index), Count
mindex_3 = MemberIndex(Set=split_2.Positive, Member="name")  # -> flatten(Index), Count

item = ListItem(List=split, Index=flatten([mindex.Index, mindex_2.Index, mindex_3.Index]), Wrap=True)
join = TextJoin(Text=item, Join=",")  # -> flatten(Result)

item_2 = ListItem(List=split_2.Negative, Index=mindex_2.Index, Wrap=True)  # -> flatten(Item)
item_3 = ListItem(List=split_2.Negative, Index=mindex_3.Index, Wrap=True)  # -> flatten(Item)
item_4 = ListItem(List=split_2.Negative, Index=mindex.Index, Wrap=True)  # -> simplify(Item)
flip = FlipMatrix(Data=item_4)

# ---- group: Dataviz
txt = Text(panel_3)
data = Data(item_2)
addition = Addition(A="5", B=".2")
addition_2 = Addition(A=".6", B=".2")
lng = ListLength(List=txt)
lng_2 = ListLength(List=data)  # -> flatten(Length)
series_2 = Series(Start=addition, Step=addition_2, Count=lng)
pt_2 = ConstructPoint(XCoordinate=0, YCoordinate=series_2, ZCoordinate=0)
repeat = RepeatData(Data=ColourSwatch(SwatchColor=RGB(255, 255, 255)), Length=lng)  # -> simplify(graft(Data))
col_3 = Colour(simplify(graft([_8dd3c7, _121212, bebada, fb8072, _80b1d3, fdb462])))
series_3 = Series(Start=".5", Step=1, Count=lng_2)
rectangle = Rectangle(Plane=pt_2, XSize=lng_2, YSize=".6", Radius=0)  # -> Rectangle, Length
mplane = MeshPlane(Boundary=rectangle.Rectangle, WidthCount=lng_2, HeightCount="1")  # -> simplify(graft(Mesh)), Area
addition_3 = Addition(A=series_3, B=".35")
division = Division(A=".6", B="2")
legendpar = LBLegendParameters(seg_count="2", colors=[repeat, col_3], seg_height=division, seg_width=".5")  # -> leg_par; plug-in component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
pt_3 = ConstructPoint(XCoordinate=series_3, YCoordinate="-.5", ZCoordinate=0)
pt_4 = ConstructPoint(XCoordinate=addition_3, YCoordinate="-.5", ZCoordinate=0)
prot = RotatePlane(Plane=pt_3, Angle="Pi/2")
prot_2 = RotatePlane(Plane=pt_4, Angle="Pi/2")
heatmap = LBSpatialHeatmap(values=flip, mesh=mplane.Mesh, legend_par=legendpar, legend_title=graft(txt))  # -> mesh, legend, title, colors, legend_par; plug-in component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
tag = TextTag3D(Location=prot, Text=data, Size=".4", Colour=col, Justification=6)
tag_2 = TextTag3D(Location=prot_2, Text=item_3, Size=".2", Colour=col, Justification=6)

# ----
lng_3 = ListLength(List=join)

shadows = Integer(Tree({4824}: [0, 0, 0, 0, 0, 0, 0, 0, 0, 0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], {4825}: [0, 0, 0, 0, 0, 0, 0, 0, 0, 0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], {4826}: [0, 0, 0, 0, 0, 0, 0, 0, 0, 0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], {4827}: [0, 0, 0, 0, 0, 0, 0, 0, 0, 0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], {4828}: [0, 0, 0, 0, 0, 0, 0, 0, 0, 0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], {4829}: [0, 0, 0, 0, 0, 0, 0, 0, 0, 0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]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))
hc = Number(Tree({4824}: [5, 5, 5, 5, 5, 5, 5, 5, 5, 5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], {4825}: [5, 5, 5, 5, 5, 5, 5, 5, 5, 5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], {4826}: [5, 5, 5, 5, 5, 5, 5, 5, 5, 5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], {4827}: [5, 5, 5, 5, 5, 5, 5, 5, 5, 5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], {4828}: [5, 5, 5, 5, 5, 5, 5, 5, 5, 5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], {4829}: [5, 5, 5, 5, 5, 5, 5, 5, 5, 5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]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))
precipitations = Number(Tree({4824}: [0.623], {4825}: [0.623], {4826}: [0.623], {4827}: [0.623], {4828}: [0.623], {4829}: [0.623]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))
temp_c = Number(Tree({4824}: [20], {4825}: [19.1], {4826}: [19], {4827}: [18], {4828}: [16], {4829}: [15]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))
tag_3 = Text(item_2)
tint_c = Number(16)
matdb = Text(join)
rad = Number(Tree({4824}: [0], {4825}: [0], {4826}: [0], {4827}: [0], {4828}: [0], {4829}: [9]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))

repeat_2 = RepeatData(Data=hc, Length=lng_3)  # -> simplify(Data)
repeat_3 = RepeatData(Data=shadows, Length=lng_3)  # -> simplify(Data)
hops = Hops(
    _Path="http://py.echoes.paris:5090/surface_temp",
    _Enabled=falsestart,
    Material_tag=tag_3,
    Db_temp=temp_c,
    Hc_data=repeat_2,
    Precipitation=precipitations,
    Tint=tint_c,
    Materials_info=matdb,
    Global_radiation=rad,
    Shadows=repeat_3,
    CacheResultsInMemory=False,
    CacheSolveResults=False,
    RemoteDefinitionLocation="http://py.echoes.paris:5090/surface_temp",
    RemoteSolveVersion=(0, 1, 0),
    ShowInput_Enabled=True,
    ShowInput_Path=True,
    SynchronousSolve=True)  # -> Surf_temp_K, Surf_temp_C, Mesh_Path, HOY_Path
assign_paths = AssignPaths(InputData=flatten(hops.Surf_temp_C), PathsToAssign=flatten(hops.Mesh_Path))
bnd = Bounds(Numbers=flatten(assign_paths))
dedomain = DeconstructDomain(Domain=bnd)  # -> Start, End
lng_4 = ListLength(List=matdb)  # -> expr("x-1", Length)
legendpar_2 = LBLegendParameters(
    min=dedomain.Start,
    max=dedomain.End,
    seg_count="11",
    colors=colrange,
    continuous_leg="0",
    num_decimals="0",
    larger_smaller="0",
    vert_or_horiz="0",
    base_plane=xy)  # -> leg_par; plug-in component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
panel_4 = Panel(bnd)
rectangle_2 = Rectangle(Plane=PlaneXY(0, 0, 0), XSize=lng_4, YSize="0 to 5", Radius=0)  # -> Rectangle, Length
mplane_2 = MeshPlane(Boundary=rectangle_2.Rectangle, WidthCount=lng_4, HeightCount="24")  # -> Mesh, Area
flip_2 = FlipMatrix(Data=assign_paths)
heatmap_2 = LBSpatialHeatmap(values=flatten(flip_2), mesh=mplane_2.Mesh, legend_par=legendpar_2, legend_title="[°C]")  # -> mesh, legend, title, colors, legend_par; plug-in component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

# ---- group: Results
mesh = Mesh(heatmap_2.mesh)
tag_4 = TextTag3D(Location=pt, Text=concat, Size=".15", Colour=col_2, Justification=6)
