# Grasshopper definition ee_surface-temperature.gh (Grasshopper 1.0.7)
# plug-ins: HDTTreeUtils, MeshEdit Components, Human, Hops, LadybugGrasshopper, treesloth01

panel = Panel("https://energyplus-weather.s3.amazonaws.com/europe_wmo_region_6/FRA/FRA_Paris.Orly.071490_IWEC/FRA_Paris.Orly.071490_IWEC.zip")
panel_2 = Panel("C:\Users\SP\ECHOES\IN - DATA\WeatherData\Paris_2003_HeatWave\Paris_2003_HeatWave.epw")
button = Button()  # disabled
epwmap = LBEPWmap(epw_map=button)  # -> report; disabled; plug-in component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
mesh = Mesh(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)
mesh_2 = Mesh([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])
matdb = Text(["alb,em,Cv,lambd,ep,kc,ID", "0.05,0.95,2251000,0.74,0.2,0,AS1", "0.4,0.95,2214000,0.74,0.2,0,AS2", "0.38,0.95,2348300,0.74,0.2,0,AS3", "0.3,0.94,1729000,2,0.2,0,CC1", "0.4,0.94,2083000,2,0.2,0,CC2", "0.45,0.94,2083000,2,0.2,0,CC3", "0.2,0.94,2083000,2,0.2,0,CC4", "0.15,0.94,2083000,2,0.2,0,CC5", "0.31,0.94,2083000,2,0.2,0,CC6", "0.45,0.94,2083000,2,0.2,0,CC7", "0.45,0.94,2083000,1.65,0.2,0,CC8", "0.25,0.94,2083000,1.65,0.2,0,CC9", "0.29,0.94,1680000.0,0.8,0.2,0.0,CM1", "0.23,0.91,1680000.0,0.8,0.2,0.0,CM2", "0.41,0.95,1680000.0,0.8,0.2,0.0,CM3", "0.3,0.94,1680000.0,0.8,0.2,0.0,CM4", "0.11,0.94,1680000.0,0.8,0.2,0.0,CM5", "0.09,0.95,1680000.0,0.8,0.2,0.0,CM6", "0.17,0.94,1680000.0,0.8,0.2,0.0,CM7", "0.2,0.89,1680000.0,0.8,0.2,0.0,CM8", "0.22,0.94,1680000.0,0.8,0.2,0.0,CM9", "0.27,0.95,1680000.0,0.8,0.2,0.0,CM10", "0.33,0.96,2100000,2.8,0.2,0,GR1", "0.45,0.96,2100000,2.8,0.2,0,GR2", "0.25,0.96,2100000,2.8,0.2,0,GR3", "0.45,0.96,2100000,2.8,0.2,0,GR4", "0.375,0.96,2098750,1.14,0.2,0.5,HC1", "0.27,0.93,1957500,2,0.2,0,HC2", "0.29,0.962,2073500,0.79,0.2,0.7,HC3", "0.45,0.94,1680000.0,0.8,0.2,0.0,MT4", "0.12,0.94,1760000.0,1.0,0.2,0.0,MT5", "0.18,0.76,1450000,0.396,0.2,0,SD1", "0.09,0.76,2500000,2.2,0.2,0,SD2", "0.55,0.76,1450000,0.396,0.2,0,SD3", "0.45,0.93,2050000,2.3,0.2,0,ST1", "0.38,0.93,2050000,2.3,0.2,0,ST2", "0.27,0.93,2050000,2.3,0.2,0,ST3", "0.68,0.95,2106000,2.3,0.2,0,ST4", "0.2,0.95,2106000,2.3,0.2,0,ST5", "0.45,0.95,2300000,1.5,0.2,0,ST6", "0.12,0.94,2120000,3.5,0.2,0,ST7", "0.09,0.92,1500000,2,0.2,0,ST8", "0.38,0.92,2438000,2,0.2,0,STS1", "0.38,0.92,2517500,2,0.2,0,STS2", "0.35,0.92,2438000,2,0.2,0,STS3", "0.33,0.98,2500000,0.28,0.2,1,VG1", "0.13,0.91,2500000,0.28,0.2,0.8,VG2", "0.15,0.98,2500000,0.19,0.2,1.3,VG3", "0.1,0.98,2500000,0.13,0.2,1.3,VG4", "0.3,0.96,720000,2,0.2,0.7,VG5", "0.3,0.91,52500,0.06,0.2,0,VG6", "0.35,0.9,960000,0.23,0.2,0,VG7", "0.29,0.98,2140000,0.5574,0.2,0,VG8", "0.29,0.98,1900000,0.321,0.2,0,VG9", "0.25,0.98,2500000,0.912,0.2,0,VG10", "0.06,0.96,4186000,0.66,0.2,1,WT1", "0.06,0.96,4186001,0.66,0.2,1,WT2"])
mesh_3 = Mesh([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])
txt = Text(["AS2", "CC1", "VG2", "VG2"])
mesh_4 = Mesh([mesh, mesh_2])
txt_2 = Text(panel)
matdb_2 = GetString(matdb, AtLeast=0, AtMost=2147483647, Prompt="Material Database", TreeAccess=False)
geometry = GetGeometry(
    mesh_3,
    AnnotationTypeFilter=0,
    AtLeast=0,
    AtMost=2147483647,
    DeleteInput=False,
    Filter=1073741856,
    Prompt="Geometries Meshes",
    TreeAccess=False)
materials = GetString(txt, AtLeast=0, AtMost=2147483647, Prompt="Materials (1 for each mesh)", TreeAccess=False)
context = GetGeometry(
    mesh_4,
    AnnotationTypeFilter=0,
    AtLeast=0,
    AtMost=2147483647,
    DeleteInput=False,
    Filter=1073741856,
    Prompt="Buildings, trees",
    TreeAccess=False)
month = GetInteger("7", AtLeast=0, AtMost=1, Maximum=2147483647, Minimum=-2147483648, TreeAccess=False)
day = GetInteger("21", AtLeast=0, AtMost=1, Maximum=2147483647, Minimum=-2147483648, TreeAccess=False)
epwurl = GetFilePath(
    txt_2,
    AtLeast=0,
    AtMost=1,
    Prompt="https://energyplus-weather.s3.amazonaws.com/europe_wmo_region_6/FRA/FRA_Paris.Orly.071490_IWEC/FRA_Paris.Orly.071490_IWEC.zip",
    TreeAccess=False)
downloadepw = LBDownloadWeather(weather_URL=epwurl)  # -> epw_file, stat_file, ddy_file; plug-in component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
bool = Boolean("1")
graft = GraftTree(Tree=geometry, IncludeEmptyLists=True, IncludeNullItems=True)
graft_2 = GraftTree(Tree=materials, IncludeEmptyLists=True, IncludeNullItems=True)
mjoin = MeshJoin(Meshes=flatten(context))
importepw = LBImportEPW(epw_file=downloadepw.epw_file)  # -> location, dry_bulb_temperature, dew_point_temperature, relative_humidity, wind_speed, wind_direction, direct_normal_rad, diffuse_horizontal_rad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; plug-in component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
_121212 = ColourSwatch(SwatchColor=RGB(18, 18, 18))
_999999 = ColourSwatch(SwatchColor=RGB(153, 153, 153))
f0f0f0 = ColourSwatch(SwatchColor=RGB(240, 240, 240))
black = ColourSwatch(SwatchColor=RGB(0, 0, 0))
# Load site from Rhino
mjoin_2 = MeshJoin(Meshes=graft)
analysisperiod = LBAnalysisPeriod(start_month=month, start_day=day, start_hour=0, end_month=month, end_day=day)  # -> period, simplify(hoys), dates; plug-in component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
facen = FaceNormals(Mesh=mjoin_2)  # -> simplify(Centers), Normals
mesh_5 = Mesh(mjoin)
lng = ListLength(List=facen.Centers)

# ----
# PERIOD
assign_paths = AssignPaths(InputData=flatten(analysisperiod.hoys), PathsToAssign=flatten(analysisperiod.hoys))
item = ListItem(List=analysisperiod.hoys, Index=0, Wrap=True)
lng_2 = ListLength(List=analysisperiod.hoys)

repeat = RepeatData(Data=simplify(graft_2), Length=simplify(lng))  # -> simplify(flatten(Data))
sunpath = LBSunPath(location=importepw.location, hoys=analysisperiod.hoys, scale=1)  # -> report, vectors, altitudes, azimuths, hoys, sun_pts, analemma, daily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; plug-in component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
mjoin_3 = MeshJoin(Meshes=flatten(mjoin_2))
# Shadows
vec = Vector(simplify(graft(sunpath.vectors)))
data = Data(repeat)
mesh_6 = Mesh(mjoin_3)
col = Colour([black, f0f0f0])
xy = XYPlane(Origin=Point(0, 0, 0))
legendpar = LBLegendParameters(seg_count="2", colors=col, continuous_leg=Toggle(False), vert_or_horiz=Toggle(False), base_plane=xy)  # -> leg_par; plug-in component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
panel_3 = Panel("http://127.0.0.1:5000/")
directsunhours = LBDirectSunHours(
    vectors=vec,
    timestep="1",
    geometry=flatten(mesh_6),
    context=flatten(mesh_5),
    grid_size="10",
    legend_par=legendpar,
    run=bool)  # -> report, points, results, mesh, legend, title, int_mtx; plug-in component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

number_slider = Slider(14, range=0..14)  # disabled
branch = TreeBranch(Tree=simplify(directsunhours.mesh), Path=number_slider, MaintainPaths=True)  # disabled

facen_2 = FaceNormals(Mesh=mesh_6)  # -> Centers, Normals

set_difference = SetDifference(SetA=analysisperiod.hoys, SetB=sunpath.hoys)
branch_2 = TreeBranch(Tree=simplify(directsunhours.points), Path="0", MaintainPaths=True)
lng_3 = ListLength(List=branch_2)
repeat_2 = RepeatData(Data=graft(set_difference), Length=lng_3)
repeat_3 = RepeatData(Data=graft(sunpath.hoys), Length=lng_3)
lng_4 = ListLength(List=flatten(repeat_2))
repeat_4 = RepeatData(Data="0", Length=lng_4)
assign_paths_2 = AssignPaths(InputData=flatten(repeat_4), PathsToAssign=flatten(repeat_2))
assign_paths_3 = AssignPaths(InputData=flatten(directsunhours.results), PathsToAssign=flatten(repeat_3))
merge = Merge(Data1=assign_paths_2, Data2=assign_paths_3)

vdis = VectorDisplay(Anchor=facen_2.Centers, Vector=facen_2.Normals)

# ----
# WIP-non-horizontal surfaces
direct_rad = Data(importepw.direct_normal_rad)  # disabled
diffuse_rad = Data(importepw.diffuse_horizontal_rad)  # disabled
hoys = Integer(assign_paths)  # disabled
location = Data(importepw.location)  # disabled
panel_4 = Panel("0")  # disabled
skymatrix = LBCumulativeSkyMatrix(location=location, direct_rad=direct_rad, diffuse_rad=diffuse_rad, hoys=hoys, high_density=panel_4)  # -> report, sky_mtx; disabled; plug-in component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
assign_paths_4 = AssignPaths(InputData=flatten(skymatrix.sky_mtx), PathsToAssign=flatten(hoys))  # disabled
panel_5 = Panel(".1")  # disabled
panel_6 = Panel("10")  # disabled

hoys_2 = Data(analysisperiod.hoys)
lng_5 = ListLength(List=hoys_2)
lng_6 = ListLength(List=facen_2.Centers)
repeat_5 = RepeatData(Data="5", Length=lng_5)  # -> simplify(graft(Data))
repeat_6 = RepeatData(Data=graft(hoys_2), Length=lng_6)  # -> simplify(Data)
# hc default
repeat_7 = RepeatData(Data=repeat_5, Length=lng_6)  # -> simplify(Data)
assign_paths_5 = AssignPaths(InputData=flatten(repeat_7), PathsToAssign=flatten(repeat_6))

# ---- group: global_rad
applyper = LBApplyAnalysisPeriod(data=importepw.global_horizontal_rad, period=analysisperiod.period)  # -> data; plug-in component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
xdata = LBDeconstructData(data=applyper)  # -> header, values; plug-in component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
assignpaths = AssignPaths(InputData=flatten(xdata.values), PathsToAssign=flatten(analysisperiod.hoys))

# ----
# Ground
analysisperiod_2 = LBAnalysisPeriod(start_month=1, start_day=1, start_hour=0)  # -> period, simplify(hoys), dates; plug-in component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
applyper_2 = LBApplyAnalysisPeriod(data=importepw.ground_temperature, period=analysisperiod_2.period)  # -> data; plug-in component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
xdata_2 = LBDeconstructData(data=applyper_2)  # -> header, values; plug-in component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

# ----
# WIP-hc from wind speed
panel_7 = Panel("C:\Users\SP\ECHOES\lab - D\ee_ICE\")  # disabled
panel_8 = Panel("ICE_hc from Wv.gh")  # disabled
concat = Concatenate(FragmentA=panel_7, FragmentB=panel_8)  # disabled
hops = Hops(
    _Path=concat,
    CacheResultsInMemory=True,
    CacheSolveResults=True,
    RemoteDefinitionLocation="C:\Users\SP\ECHOES\lab - D\ee_ICE\ICE_hc from Wv.gh",
    RemoteSolveVersion=(0, 1, 0),
    ShowInput_Enabled=False,
    ShowInput_Path=True,
    SynchronousSolve=True)  # disabled

rad = LBFalseStartToggle(False)  # disabled
datetime = LBHOYToDateTime(hoy=analysisperiod.hoys)  # -> month, day, hour, minute, date; plug-in component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

# ----
# ETo
# To update the ICE_ETO.csv with your City project :
# 1. Go the webpage : https://donneespubliques.meteofrance.fr/?fond=produit&id_produit=117&id_rubrique=39
# 2. Click on "Sélection et téléchargement" at the bottom of the web page
# 3. Choose the city, click on the ID and download the data file
# 4. Copy the data of "Evapotranspiration Potentielle (ETP Penman moyenne en mm)" into the csv
precipitations_mm_month = Panel("""51
41.2
47.6
51.8
63.2
49.6
62.3
52.7
47.6
61.5
51.1
57.8""")
panel_9 = Panel("""0.01
0.01
0.01
0.01
0.01
0.01
0.01
0.01
0.01
0.03
0.06
0.09
0.1
0.11
0.11
0.11
0.09
0.07
0.04
0.03
0.02
0.01
0.01
0.01""")
ma = MassAddition(Input=panel_9)  # -> Result, PartialResults
panel_10 = Panel(ma.Result)
graph = QuickGraph(panel_9, SortOrder=0)
item_2 = ListItem(List=precipitations_mm_month, Index=datetime.month, Wrap=True)
item_3 = ListItem(List=panel_9, Index=datetime.hour, Wrap=True)
multiplication = Multiplication(A=item_2, B=item_3)

# ----
# Temperature
applyper_3 = LBApplyAnalysisPeriod(data=importepw.dry_bulb_temperature, period=analysisperiod.period)  # -> data; plug-in component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
xdata_3 = LBDeconstructData(data=applyper_3)  # -> header, values; plug-in component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

incidentradiation = LBIncidentRadiation(
    sky_mtx=assign_paths_4,
    geometry=flatten(mesh_6),
    context=flatten(mesh_5),
    grid_size=panel_6,
    offset_dist=panel_5,
    run=rad)  # -> report, points, results, total, mesh, legend, title, int_mtx; disabled; plug-in component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
number_slider_2 = Slider(8, range=0..23)  # disabled

# ---- group: provisory
hc = Number(assign_paths_5)
panel_11 = Panel(hc)

# ----
assign_paths_6 = AssignPaths(InputData=flatten(xdata_3.values), PathsToAssign=flatten(analysisperiod.hoys))
assign_paths_7 = AssignPaths(InputData=flatten(multiplication), PathsToAssign=flatten(analysisperiod.hoys))
renumber = RenumberPaths(Data=incidentradiation.mesh)  # disabled
subtraction = Subtraction(A=month, B=1)
kwh_m²_wh_m² = Number(expr("x*1000", incidentradiation.results))  # disabled
item_4 = ListItem(List=xdata_2.values, Index=subtraction, Wrap=True)
branch_3 = TreeBranch(Tree=simplify(renumber), Path=number_slider_2, MaintainPaths=True)  # disabled
avr = Average(Input=flatten(item_4))
bnd = Bounds(Numbers=flatten(kwh_m²_wh_m²))  # disabled
rad_2 = Number(incidentradiation.results)  # disabled

panel_12 = Panel(lng_2)  # disabled
H = Slider(12, range=0..71)  # disabled

mesh_points = Data(facen_2.Centers)

shadows = Integer(merge)
tag = Text(data)

hc_2 = Number(hc)

# ----
# Reduce
graft_3 = GraftTree(Tree=tag, IncludeEmptyLists=True, IncludeNullItems=True)  # -> simplify(Tree)
flip = FlipMatrix(Data=shadows)
join = TextJoin(Text=[graft_3, flip], Join=";")  # -> flatten(Result)
viewer = ParamViewer(shadows)
cset = CreateSet(List=join)  # -> Set, Map
dpath = DeconstructPath(Branch=viewer)  # -> simplify(Indices)
split = TextSplit(Text=cset.Set, Separators=";")  # -> simplify(Result)
split_2 = SplitList(List=split, Index="1")  # -> flatten(ListA), simplify(ListB)
int = Integer(cset.Map)
cset_2 = CreateSet(List=int)  # -> Set, Map
flip_2 = FlipMatrix(Data=split_2.ListB)
lng_7 = ListLength(List=flip_2)
repeat_8 = RepeatData(Data=dpath, Length=lng_7)  # -> simplify(Data)
assign_paths_8 = AssignPaths(InputData=flatten(flip_2), PathsToAssign=flatten(repeat_8))
item_5 = ListItem(List=mesh_points, Index=cset_2.Set, Wrap=True)
item_6 = ListItem(List=hc_2, Index=cset_2.Set, Wrap=True)

panel_13 = Panel("0")  # disabled
panel_14 = Panel("1000")  # disabled
addition = Addition(A=item, B=H)  # disabled

panel_15 = Panel("1")  # disabled
colrange = LBColorRange(index=panel_15)  # -> colors; disabled; plug-in component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
data_2 = Data(kwh_m²_wh_m²)  # disabled
legendpar_2 = LBLegendParameters(min=panel_13, max=panel_14, colors=colrange)  # -> leg_par; disabled; plug-in component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
branch_4 = TreeBranch(Tree=simplify(data_2), Path=addition, MaintainPaths=True)  # disabled
panel_16 = Panel("RAD [Wh/m²]")  # disabled

heatmap = LBSpatialHeatmap(values=branch_4, mesh=mesh_6, legend_par=legendpar_2, legend_title=panel_16)  # -> mesh, legend, title, colors, legend_par, vis_set; disabled; plug-in component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
lng_8 = ListLength(List=mesh_points)
lng_9 = ListLength(List=item_5)
expression = Expression(x=lng_8, y=lng_9, Expression="Round((x-y)/x*100,0)")

# ---- group: reduced
mesh_points_2 = Point(item_5)  # disabled
tag_2 = Text(split_2.ListA)
shadows_2 = Integer(assign_paths_8)
hc_3 = Number(item_6)

# ----
reduced = Panel(expression)
int_2 = Integer(avr)
# Tint= 308.15  #Temperature of the ground in K
#     hc=5 # Wind coefficient W.m-2.K-1
# sigma = 5.57e-08 #Stefan - Boltzman constant in W.m-2.K-4
# threshold = 0.01 # Calculation threshold, default = 1%
panel_17 = Panel(int_2)

precipitations = Number(assign_paths_7)
temp_c = Number(assign_paths_6)
tint_c = Number("16")
matdb_3 = Text(matdb_2)
# constants
rad_3 = Number(assignpaths)

data_3 = Data(bool)

# ----
# keep async off
hops_2 = Hops(
    _Path="http://127.0.0.1:5000/surface_temp",
    _Enabled=data_3,
    Material_tag=tag_2,
    Db_temp=temp_c,
    Hc_data=hc_3,
    Precipitation=precipitations,
    Tint=tint_c,
    Materials_info=matdb_3,
    Global_radiation=rad_3,
    Shadows=shadows_2,
    CacheResultsInMemory=False,
    CacheSolveResults=False,
    RemoteDefinitionLocation="http://127.0.0.1:5000/surface_temp",
    RemoteSolveVersion=(0, 1, 0),
    ShowInput_Enabled=True,
    ShowInput_Path=True,
    SynchronousSolve=True)  # -> Surf_temp_K, Surf_temp_C, Mesh_Path, HOY_Path

assign_paths_9 = AssignPaths(InputData=flatten(hops_2.Surf_temp_C), PathsToAssign=flatten(hops_2.Mesh_Path))
panel_18 = Panel(assign_paths_9)

# ---- group: remap from reduced
int_3 = Integer(cset.Map)
branch_5 = TreeBranch(Tree=assign_paths_9, Path=int_3, MaintainPaths=False)

# ----
mesh_7 = Mesh(mesh_6)
num = Number(branch_5)
context_bake = ContextBake(Geometry=mesh_7)
context_print = ContextPrint(TC=num)

pt = Point(Point(-9.172957589, -45.40146084, 0))  # disabled
panel_19 = Panel(".5")  # disabled
swatch = ColourSwatch(SwatchColor=RGB(0, 0, 0))  # disabled
panel_20 = Panel("3")  # disabled

hourlyplot = LBHourlyPlot(data=importepw.dry_bulb_temperature, base_pt=pt, x_dim=panel_19, y_dim=panel_19)  # -> report, mesh, legend, borders, labels, title, vis_set; disabled; plug-in component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

item_7 = ListItem(List=hourlyplot.mesh, Index=0, Wrap=True)  # disabled
explode = MeshExplode(Mesh=item_7, Interpolate=False)  # disabled
item_8 = ListItem(List=explode, Index=analysisperiod.hoys, Wrap=True)  # disabled
mjoin_4 = MeshJoin(Meshes=item_8)  # disabled
medges = MeshEdges(Mesh=mjoin_4)  # -> NakedEdges, InteriorEdges, NonManifoldEdges; disabled
join_2 = JoinCurves(Curves=medges.NakedEdges, Preserve=False)  # disabled
previewlw = CustomPreviewLineweights(Geometry=join_2, Shader=swatch, Thickness=panel_20, Absolute=False)  # disabled
